# Grasshopper definition infinity-mirror-hex.gh (Grasshopper 1.0.7)

number_slider = Slider(48, range=0..100)
pt = Point(Point(0, 0, 0))
wall_thickness = Slider(2, range=0..10)
addition = Addition(A=number_slider, B=wall_thickness)
number_slider_2 = Slider(71, range=0..100)
number_slider_3 = Slider(6, range=0..10)
circle = CircleCNR(Center=pt, Normal=Vector(0, 0, 1), Radius=addition)
circle_2 = CircleCNR(Center=pt, Normal=Vector(0, 0, 1), Radius=number_slider)
subtraction = Subtraction(A=number_slider_2, B=wall_thickness)
wall_height = Slider(12, range=0..20)
polygon = Polygon(Plane=pt, Radius=number_slider_2, Segments=number_slider_3, FilletRadius=0)  # -> Polygon, Length
polygon_2 = Polygon(Plane=pt, Radius=subtraction, Segments=number_slider_3, FilletRadius=0)  # -> Polygon, Length
boundary = BoundarySurfaces(Edges=[circle_2, circle])
boundary_2 = BoundarySurfaces(Edges=[polygon.Polygon, circle_2])
boundary_3 = BoundarySurfaces(Edges=[polygon.Polygon, polygon_2.Polygon])
Z = UnitZ(Factor=Slider(16, range=0..100))
Z_2 = UnitZ(Factor=wall_height)
Z_3 = UnitZ(Factor=wall_thickness)
walls = Extrude(Base=boundary_3, Direction=Z_2)
base_srfc = Extrude(Base=boundary_2, Direction=Z_3)
ring = Extrude(Base=boundary, Direction=Z)
base = SolidUnion(Breps=[walls, base_srfc])
